# Grasshopper definition model.gh (Grasshopper 0.9.76)
# plug-ins: Python Interpreter

# material resistance
# angleA
# material resistance
# angleB
# force
# speed
# angleA
# angleB
# force
# speed
# angleA
# angleB
# force
# speed
# angleA
# angleB
# speed
# material resistance
# force
# angleA
# angleB
# speed
# force
# angleA
# angleB
# speed
# material resistance
# material resistance
# material resistance
# force
# force
# force
# angleA
# angleA
# angleA
# angleB
# angleB
# angleB
# speed
# speed
# speed
# force
# force
# force
# angleA
# angleA
# angleA
# angleB
# angleB
# angleB
# speed
# speed
# speed
panel = Panel("ws://129.132.205.252:9090/")
# angleB
# speed
# data for further calculation
# set path
# set path
# set path
# set path
# set path
# set path
# set path
# force
# force
# force
# force
# force
# force
# angleA
# angleA
# angleA
# angleA
# angleA
# angleA
# angleB
# angleB
# angleB
# angleB
# angleB
# angleB
# speed
# speed
# speed
# speed
# speed
# speed
# force
# force
# force
# force
# force
# force
# angleA
# angleA
# angleA
# angleA
# angleA
# angleA
# angleA
# angleA
# angleA
# angleA
# angleA
# angleA
# angleA
# angleB
# angleB
# angleB
# angleB
# angleB
# angleB
# speed
# speed
# speed
# speed
# speed
# speed
# speed
# speed
# speed
# speed
# speed
# speed
# speed
# data for further calculation
# data for further calculation
# data for further calculation
# data for further calculation
# data for further calculation
# data for further calculation
# material resistance
# force
# angleA
# angleB
# speed
# force
# angleA
# angleB
# speed
bang = Button()

# ---- group: Robot
# 1. load robot model
# 2. set tool
# 3. set basis
list = ValueList({"no_tool", "measurement_tool"}, selected="no_tool")
tools = Tools(tool_name=list)
base = PythonScript()  # -> base_frame
# ---------- base: Python ----------
from compas_fabrication.fabrication.geometry import Frame
from compas.geometry.elements import Vector

origin = [300,300,0]
xaxis  = [0, 1, 0]
yaxis  = [1, 0, 0]

base_frame = Frame(list(origin), list(xaxis), list(yaxis))
# ---------- end base ----------
list_2 = ValueList({"UR5", "UR10"}, selected="UR10")
robot = PythonScript(model=list_2, tool=tools)  # -> robot
# ---------- robot: Python ----------
from compas_fabrication.fabrication.robots.ur.ur10 import UR10
from compas_fabrication.fabrication.robots.ur.ur5 import UR5

if model == "UR5":
    robot = UR5()
elif model == "UR10":
    robot = UR10()

if tool:
    robot.set_tool(tool)
if base_frame:
    robot.set_base(base_frame)
# ---------- end robot ----------

# ----
panel_2 = Panel("/follow_joint_trajectory/result")  # disabled

# ---- group: Define path in WCS, calculate joint positions / Define path
number = Slider(30, range=0..100)
Z = UnitZ(Factor=-1)
crv = Curve(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)
py = PythonScript(crv=crv, number=number, normal=Z)  # -> planes
# ---------- py: Python ----------
import Rhino.Geometry as rg

normal.Unitize()

# 1. Divide curve
params = rg.Curve.DivideByCount(crv, number - 1, True)
planes = []
for param in params:
    point = rg.Curve.PointAt(crv, param)
    tangent = rg.Curve.TangentAt(crv, param)
    tangent.Unitize()
    # tangent = xaxis, normal is given, so we calculate yaxis
    yaxis = rg.Vector3d.CrossProduct(normal, tangent)
    yaxis.Unitize()
    planes.append(rg.Plane(point, tangent, yaxis))
    
print len(params)
# ---------- end py ----------

# ---- group: ROS connection through Websocket
reset = Button()
subscribe = Subscribe(Topic="/joint_states")  # -> R
# ---------- subscribe: Python ----------
import json


data = {
"op":"subscribe",
"topic":Topic
}

R = json.dumps(data)
# ---------- end subscribe ----------
websocket_client_start = WebsocketClientStart(Address="ws://192.168.10.12:9090/", InitalMessage="Hello World", Reset=reset)
websocket_client_receiver = WebsocketClientReceiver(WebsocketObjects=websocket_client_start, AutoUpdate=True)  # -> Message, Status
py_2 = PythonScript(msg=websocket_client_receiver.Message)  # -> joint_states
# ---------- py_2: Python ----------
import ast

try:
    msg = ast.literal_eval(msg)
    joint_states = msg["msg"]["position"]
    print joint_states
except:
    joint_states = None
# ---------- end py_2 ----------
dam = DataDam(DataA=py_2, BufferDelay=2500000, BufferMode=0)
websocket_client_sender = WebsocketClientSender(WebsocketObjects=websocket_client_start, Message=subscribe)
joint_states = Panel(dam)
joint_states_2 = Data(dam)

# ----
panel_3 = Panel("/follow_joint_trajectory/feedback")  # disabled
unload = PythonScript(bang=bang)
# ---------- unload: Python ----------
from compas_fabrication.fabrication.grasshopper.utilities import unload_modules

unload_modules("compas")
# ---------- end unload ----------
publish_string = PublishString()  # -> R; disabled
# ---------- publish_string: Python ----------
import json


data = {
"op":"publish",
"topic":Topic,
"msg":{
    "data":Msg
}
}

R = json.dumps(data)
# ---------- end publish_string ----------
ros_topic_types = ROSTopicTypes({"String": "std_msgs/String", "Twist": "geometry_msgs/Twist"}, selected="Twist")  # disabled
panel_4 = Panel(ros_topic_types)  # disabled

# ---- group: Define path in WCS, calculate joint positions
joint_states_3 = Data([-0.1728179112, -1.415058186, 1.813991282, -1.971940356, -1.571654205, -3.308720436])
init_configuration = Slider(2, range=0..7)
py_3 = PythonScript(robot=robot, planes_WCS=py, configuration_idx=init_configuration, init_configuration=joint_states_3)  # -> configurations; inputs planes_WCS: list, configuration_idx: Int32, init_configuration: list
# ---------- py_3: Python ----------
import Rhino.Geometry as rg
from compas_fabrication.fabrication.geometry import Frame, Transformation
from compas_fabrication.fabrication.grasshopper import xdraw_frame
from compas_fabrication.fabrication.robots.ur.kinematics import calculate_configurations_for_path, format_joint_positions


# TODO this must be optimized! matrix multiplication!
frames_tool0_RCS = []
for plane_WCS in planes_WCS:
    tcp_WCS = Frame(plane_WCS.Origin, plane_WCS.XAxis, plane_WCS.YAxis)
    tcp_RCS = robot.get_frame_in_RCS(tcp_WCS)
    frames_tool0_RCS.append(robot.get_tool0_frame_from_tcp_frame(tcp_RCS))
    

configurations = calculate_configurations_for_path(frames_tool0_RCS, robot.params, init_configuration)

configurations = configurations[min([configuration_idx, len(configurations) - 1])]

def format(numbers, k=4):
    #numbers = format_joint_positions(numbers)
    return "[" + ", ".join([("%." + str(k) + "f") % n for n in numbers]) + "]"

print "Q1 = ", format(configurations[0])
print "Q2 = ", format(configurations[10])
print "Q3 = ", format(configurations[20])

"""
Q1 =  [-0.1727, -1.4144, 1.8145, -1.9709, -1.5708, 2.9757]
Q2 =  [-0.6497, -1.4872, 1.7623, -1.7329, -1.7115, -2.4608]
Q3 =  [-1.2111, -1.9716, 2.4040, -1.9940, -1.6098, -2.9102]
"""
# ---------- end py_3 ----------
start = Button()
stop = Button()
step = Button()
counter = CountThroughList(L=py_3, start=start, stop=stop, step=step, interval=100)  # -> item; inputs L: list, start: Boolean, stop: Boolean
# ---------- counter: Python ----------
from scriptcontext import sticky as st
from compas_fabrication.fabrication.grasshopper import gh_component_timer


# store data in component
guid = str(ghenv.Component.InstanceGuid)
counter_key = "counter_" + guid
running_key = "running_" + guid

if counter_key not in st:
    st[counter_key] = 0

if running_key not in st:
    st[running_key] = False

if start:
    st[running_key] = True

if stop:
    st[running_key] = False

if step:
    st[counter_key] += 1
    
if len(L):
    item = L[st[counter_key]]

if st[running_key]:
    if st[counter_key] < len(L) - 1:
        st[counter_key] += 1
        gh_component_timer(ghenv, interval)
    else:
        st[counter_key] = 0
        st[running_key] = False
# ---------- end counter ----------

# ----
panel_5 = Panel(subscribe)
unsubscribe = Unsubscribe(Topic=panel_3)  # -> R; disabled
# ---------- unsubscribe: Python ----------
import json


data = {
"op":"unsubscribe",
"topic":Topic
}

R = json.dumps(data)
# ---------- end unsubscribe ----------
wsc = Data(websocket_client_start)
panel_6 = Panel("geometry_msgs/Point")  # disabled
panel_7 = Panel("/robot_path")  # disabled
subscribe_2 = Subscribe(Topic=panel_2)  # -> R; disabled; same code as subscribe
panel_8 = Panel("trajectory_msgs/JointTrajectory")  # disabled

# ---- group: Define plane in WCS, calculate joint positions
select_configuration = Slider(0, range=0..7)
pt = Point(Point(-360.5993803, 209.4895651, 549.1033298))
xy = XYPlane(Origin=pt)
plane_wcs = Plane(xy)
inverse = PythonScript(robot=robot, plane_WCS=plane_wcs, idx=select_configuration)  # -> configuration; inputs plane_WCS: Plane, idx: Int32
# ---------- inverse: Python ----------
import Rhino.Geometry as rg
from compas_fabrication.fabrication.geometry import Frame, Transformation
from compas_fabrication.fabrication.grasshopper import xdraw_frame

tcp_WCS = Frame(plane_WCS.Origin, plane_WCS.XAxis, plane_WCS.YAxis)

# transform frame to robot coordinate system
tcp_RCS = robot.get_frame_in_RCS(tcp_WCS)

# get the frame of tool0
tool0_RCS = robot.get_tool0_frame_from_tcp_frame(tcp_RCS)

# calculate solutions to frame
solutions = robot.inverse_kinematics(tool0_RCS)

if not len(solutions):
    q = [0,0,0,0,0,0]
else:
    idx = min(len(solutions) - 1, idx)
    q = solutions[idx]
    
print q

configuration = q
# ---------- end inverse ----------

# ----
advertise = Advertise(Topic=panel_7, Type=panel_6)  # -> R; disabled
# ---------- advertise: Python ----------
import json


data = {
"op":"advertise",
"topic":Topic,
"type":Type
}

R = json.dumps(data)
# ---------- end advertise ----------
panel_9 = Panel("/gh_robot_path")  # disabled

# ---- group: Define path in WCS, calculate joint positions / Shows joint positions along path
flip = BooleanToggle(True)
l2t = PythonScript(L=py_3, flip=flip)  # -> T; inputs L: list, flip: Boolean
# ---------- l2t: Python ----------
from compas_fabrication.fabrication.grasshopper import list_to_tree

if flip:
    L = zip(*L)
T = list_to_tree(L)
# ---------- end l2t ----------
graph = QuickGraph(l2t)

# ----
number_slider = Slider(6, range=0..10)  # disabled
number_slider_2 = Slider(5, range=0..10)  # disabled
number_slider_3 = Slider(7, range=0..10)  # disabled
advertise_2 = Advertise(Topic=panel_9, Type=panel_8)  # -> R; disabled; same code as advertise
timer = Timer(TimerInterval=20, Target=publish)  # disabled
panel_10 = Panel(advertise)  # disabled

# ---- group: Define joint positions
base_2 = Slider(-9.9, range=-360..360)
shoulder = Slider(-57.05, range=-360..360)
elbow = Slider(70, range=-360..360)
wrist1 = Slider(76, range=-360..360)
wrist2 = Slider(89, range=-360..360)
wrist3 = Slider(-9.5, range=-360..360)
ur1_q1_q6 = Data([base_2, wrist3, shoulder, wrist2, elbow, wrist1])
rad = Radians(Degrees=ur1_q1_q6)

# ----
publish = PythonScript(topic=panel_7, x=number_slider_2, y=number_slider, z=number_slider_3)  # -> R; disabled
# ---------- publish: Python ----------
import json


data = {
"op":"publish",
"topic":topic,
"msg":{"x":(x or 0), "y":(y or 0), "z":(z or 0)}
}

R = json.dumps(data)

print R
# ---------- end publish ----------
panel_11 = Panel(websocket_client_receiver.Message)
websocket_client_sender_2 = WebsocketClientSender(WebsocketObjects=wsc, Message=publish)  # disabled
timer_2 = Timer(TimerInterval=20, Target=publish_2)  # disabled
websocket_client_sender_3 = WebsocketClientSender(WebsocketObjects=wsc, Message=advertise_2)  # disabled
publish_2 = PythonScript(topic=panel_9, points=py_3)  # -> R; inputs points: list; disabled
# ---------- publish_2: Python ----------
import json
import sys
sys.path.append(r"C:\Users\rustr\AppData\Local\lxss\rootfs\opt\ros\kinetic\lib\python2.7\dist-packages")

from trajectory_msgs.msg import *
from control_msgs.msg import *


joint_names = ['shoulder_pan_joint', 'shoulder_lift_joint', 'elbow_joint',
               'wrist_1_joint', 'wrist_2_joint', 'wrist_3_joint']

data = {
"op":"publish",
"topic":topic,
"msg":{"joint_names":joint_names, "points": points}
}

R = json.dumps(data)

print R
# ---------- end publish_2 ----------
websocket_client_sender_4 = WebsocketClientSender(WebsocketObjects=wsc, Message=publish_2)  # disabled

# ---- group: Send joint position directly to robot
joint_positions = Data(py_3)
idx = Slider(0, range=0..100)
item = ListItem(List=joint_positions, Index=idx, Wrap=True)
list_3 = ValueList({"send all positions": 0, "send only one position": 1}, selected="send only one position")
filter = StreamFilter(Gate=list_3, Stream0=joint_positions, Stream1=item)
movel = PythonScript(joint_positions=filter, velocity=Slider(50, range=0..100))  # -> script; inputs joint_positions: list
# ---------- movel: Python ----------
script_lines = []

for position in joint_positions:
    script_lines.append("movel(%s, v=%f)" % (str(position), velocity/1000.))


script = "def prog():\n"
script += "\ttextmsg(\">> program start\")\n"
script += "".join(["\t%s\n" % line for line in script_lines])
script += "\ttextmsg(\"<< program end\")\n"
script += "end\n"
script += "prog()\n\n"


print script

#script = ""
# ---------- end movel ----------
send = Button()
list_4 = ValueList({"30001", "30002", "30003"}, selected="30002")
send_2 = PythonScript(script=movel, robot_ip="192.168.10.10", robot_port=list_4, send=send)  # -> out
# ---------- send_2: Python ----------
import socket

if send:
    s = socket.create_connection((robot_ip, robot_port), timeout=0.5) 
    s.send(script)
    s.close()
# ---------- end send_2 ----------
panel_12 = Panel(send_2)

# ---- group: Visualise / robot model brep
py_4 = PythonScript(model=list_2)  # -> n
# ---------- py_4: Python ----------
if model == "UR5":
    n = 0
if model == "UR10":
    n = 1

print n
# ---------- end py_4 ----------
ur10_brep = UR10Brep([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])
ur5_brep = UR5Brep([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])
show_brep = BooleanToggle(False)
filter_2 = StreamFilter(Gate=py_4, Stream0=ur5_brep, Stream1=ur10_brep)

# ---- group: Visualise
list_5 = ValueList({"0 forward, from angles": 0, "1 inverse, from one plane": 1, "2 inverse, from multiple planes": 2, "3 forward, from robot": 3}, selected="2 inverse, from multiple planes")
filter_3 = StreamFilter(Gate=list_5, Stream0=rad, Stream1=inverse, Stream2=counter, Stream3=joint_states_2)
configuration = Panel(filter_3)
mesh = Mesh(filter_2)
draw = PythonScript(robot=robot, configuration=filter_3, mesh=mesh, brep=filter_2, show_brep=show_brep)  # -> meshes, tool0_plane, tcp_plane, robot_brep; inputs configuration: list, mesh: list, brep: list
# ---------- draw: Python ----------
from compas_fabrication.fabrication.grasshopper import xdraw_frame
from compas_fabrication.fabrication.grasshopper import draw_mesh 
from compas_fabrication.fabrication.grasshopper import xform_from_transformation
from compas_fabrication.fabrication.geometry import Frame, Transformation
from compas_fabrication.fabrication.geometry.helpers import mesh_update_vertices

import Rhino.Geometry as rg
import Rhino

q = configuration

R0, R1, R2, R3, R4, R5 = robot.get_forward_transformations(q)
tool0_frame, tcp_frame = robot.get_transformed_tool_frames(R5)

m0, m1, m2, m3, m4, m5 = mesh
for i in range(6):
    exec("R%drg = xform_from_transformation(R%d)" % (i, i))
    exec("m%d.Transform(R%drg)" % (i, i))
meshes = [m0, m1, m2, m3, m4, m5]

"""
m0, m1, m2, m3, m4, m5, tool0_frame, tcp_frame = robot.get_transformed_model(q)
mt = robot.get_transformed_tool_model(tcp_frame)

meshes = []
meshes.append(draw_mesh(m0))
meshes.append(draw_mesh(m1))
meshes.append(draw_mesh(m2))
meshes.append(draw_mesh(m3))
meshes.append(draw_mesh(m4))
meshes.append(draw_mesh(m5))
if mt:
    meshes.append(draw_mesh(mt))

"""

tool0_plane = xdraw_frame(tool0_frame)
tcp_plane = xdraw_frame(tcp_frame)

if show_brep:
    
    b0, b1, b2, b3, b4, b5 = brep
    
    b0.Transform(R0rg)
    b1.Transform(R1rg)
    b2.Transform(R2rg)
    b3.Transform(R3rg)
    b4.Transform(R4rg)
    b5.Transform(R5rg)
    
    robot_brep = [b0, b1, b2, b3, b4, b5]
# ---------- end draw ----------
robot_brep = Brep(draw.robot_brep)
tool0_plane = Plane(draw.tool0_plane)
tcp_plane = Plane(draw.tcp_plane)
draw_2 = RepresentPlaneAsLines(plane=tcp_plane, size=100)  # -> G, C
# ---------- draw_2: Python ----------
import Rhino.Geometry as rg
from System.Drawing import Color

if plane:

    G = []
    G.append(rg.Line(plane.Origin, size * plane.XAxis))
    G.append(rg.Line(plane.Origin, size * plane.YAxis))
    G.append(rg.Line(plane.Origin, size * plane.ZAxis))
    
    C = []
    C.append(Color.FromArgb(255, 0, 0))
    C.append(Color.FromArgb(0, 255, 0))
    C.append(Color.FromArgb(0, 0, 255))
# ---------- end draw_2 ----------
preview = CustomPreview(Geometry=draw.meshes, Shader=ColourSwatch(SwatchColor=RGBA(99, 94, 94, 96)))
preview_2 = CustomPreview(Geometry=draw_2.G, Shader=draw_2.C)

# ----
panel_13 = Panel(movel)

# ---- group: breps
base_shoulder = Brep(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)
upperarm = Brep(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)
forearm = Brep(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)
wrist3_2 = Brep(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)
wrist1_2 = Brep(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)
wrist2_2 = Brep(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)

base_shoulder_2 = Brep(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)
upperarm_2 = Brep(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)
forearm_2 = Brep(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)
wrist1_3 = Brep(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)
wrist2_3 = Brep(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)
wrist3_3 = Brep(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)

# ----
ur10_geo = Brep([base_shoulder_2, wrist2_3, upperarm_2, wrist1_3, forearm_2, wrist3_3])
# inclination_length for 2, 4, 10, 15
# inclination_length for 30
# Calculate edge curves
ur5_brep_2 = Brep([base_shoulder, upperarm, forearm, wrist1_2, wrist2_2, wrist3_2])

# ==== cluster Tools
measurement_tool_geo = Geometry([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])
tool_name = ClusterInput()
py = PythonScript(rhino_geometry=measurement_tool_geo)  # -> measurement_tool; inputs rhino_geometry: list
# ---------- py: Python ----------
from compas_fabrication.fabrication.robots.ur.tools import MeasurementTool

measurement_tool = MeasurementTool()
measurement_tool.rhino_geometry = rhino_geometry
# ---------- end py ----------
tools = PythonScript(tool_name=tool_name, measurement_tool=py)  # -> tool
# ---------- tools: Python ----------
if tool_name == "measurement_tool":
    tool = measurement_tool
    print tool.tcp_frame
# ---------- end tools ----------
tool = ClusterOutput(tools)
